% Simulink data dictionary MiniDroneArchData.sldd

ActCmd = Simulink.Bus()
  elem0: double
  elem1: double
  elem2: double
  elem3: double

CSStatus = Simulink.Bus()
  CSError: double
  CSErrorCode: double

EncoderData = Simulink.Bus()
  Motor1Velocity: double
  Motor2Velocity: double
  Motor3Velocity: double
  Motor4Velocity: double

IMUData = Simulink.Bus()
  Acceleration: double[1 3]
  AngularAcceleration: double[1 3]
  Pose: double[3 3]

PPStatus = Simulink.Bus()
  PPError: boolean
  PPErrorCode: uint32

MotorCmd = Simulink.ValueType(DataType="double", be=Simulink.BusElement(Name="a", DataType="double"))

PropulsionForce = Simulink.Bus()
  ForcePropeller1: double
  ForcePropeller2: double
  ForcePropeller3: double
  ForcePropeller4: double