# Requirement set Requirement_Document (R2022a)

## 1 [Requirement Document] References to Requirement Document.docx (Container)
Read-only references to Microsoft Word document.

### 1.1 [General Information]
This SRS document described the requirements for the development of a minidrone . This multi-purpose drone is a rotary-wing flying object whose development and application range is expanding in the last decade.
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
### 1.2 [Functionalities]
The minidrone should be able to support different applications in Agriculture, Logistics and delivery, Emergency response, Inspection. To offer functionality in such broad range of applications the minidrone need to satisfy the following basic functional requirements

#### 1.2.1 [Takeoff and Land]
The minidrone must have Vertical takeoff and landing (VTOL) capabilities. This will enable the minidrone to have
- efficient maneuverability
- ability to hover steadily
- minimal space needed to launch

#### 1.2.2 [Perform Controlled Flight]
The minidrone should have a 6 DOF movement capability during flight to achieve its desired applications.

##### 1.2.2.1 [Flight Region]
Flight Range
The range of the minidrone must be at least 20 kilometers. This will extend the usability of the minidrone by allowing longer range o

##### 1.2.2.2 [Flight Control]
f operation and reach.
Flight Region
To avoid expected obstacles in its operation area, the drone must be able to achieve and maintain

#### 1.2.3 [Communicate with Ground base]
a constant altitude of 200 meters.
Flight Control
The flight is managed from a control system, and it can operate autonomously or based on guida

##### 1.2.3.1 [Camera]
nce from central location
Carry a load
The minidrone should be able to carry a maximum load of 5 kg.
Communicate with Ground base
The minidrone should be able to receive comm

### 1.3 [Project proposal group 2]
ds and send information to a ground base that controls its operation
System Components
An operation mini drone should have the following basic components
- Main Body
- Power Module
- Propulsion Module
- Flight Control Module
- Sensor Module
- Communication Module
- Payload
Main Body
The is the central hub provides structural support and housing for the other components making up the minidrone. It also contains connection point to attach the payload to the minidrone.
Power Module
The power unit should be able to provide necessary power to the propulsion, flight control and communication modules.
Propulsion Module
The propulsion module consists of one or more rotor assemblies that contain a propeller and a motor driving the propeller.
Flight Control Module
The flight control module consists of the following basic components
- Control System
- Path Planning
Control Sy

### 1.4 [“System Components]
stem
Flight controller receives data from sensors and performs calculations, designed in control strategy to control the behavior of the vehicle while performing different maneuvers
Path plann

#### 1.4.1 [Main Body]
ing
The system should plan its original path and continuously update it based on environmental factors or new user requests
Sensor Module
The minidrone should have a redundant IMU for improved cali

#### 1.4.2 [Power Module]
bration and pose estimation. It also contains encoder sensors to measure velocity of propeller motors for use as an input to the fl

#### 1.4.3 [Propulsion Module]
ight control modules.
Communication Module
The minidrone must have Wi-Fi network communication and radio communication.
Payload
The minidrone

#### 1.4.4 [Flight Control Module]
can carry different payload types depending on the application focus. A camera is the most often used payload to deliver

##### 1.4.4.1 [Control System]
images and video to a central control location.

##### 1.4.4.2 [Path planning]

#### 1.4.5 [Sensor Module]

#### 1.4.6 [Communication Module]

#### 1.4.7 [Payload]