# Requirement set req_minidwones (R2022a)

## 1 [req_minidwones] References to req_minidwones.docx (Container)
Read-only references to Microsoft Word document.

### 1.1 [Takeoff and Land]
The minidrone must have Vertical takeoff and landing (VTOL) capabilities. This will enable the minidrone to have
- efficient maneuverability
- ability to hover steadily
- minimal space needed to launch

### 1.2 [Perform Controlled Flight]
The minidrone should have a 6 DOF movement capability during flight to achieve its desired applications.

#### 1.2.1 [Fly range]
To avoid expected obstacles in its operation area, the drone must be able to achieve and maintain a constant altitude of 2 meters.

#### 1.2.2 [Altitude]
The flight is managed from a control system, and it can operate autonomously or based on guidance from central location

#### 1.2.3 [Flight Control]
The flight is managed from a control system, and it can operate autonomously or based on guidance from central location

### 1.3 [Communicate with Ground base]
The minidrone should be able to receive commands and send information to a ground base that controls its operation.

#### 1.3.1 [Camera]
The minidrone must be able to snap a picture of the package.

### 1.4 [Carry a load]
The minidrone should be able to carry a load

#### 1.4.1 [Max size]
Max size of 5x5x5 cm

#### 1.4.2 [Max weight]
Max weight of 500 grams

#### 1.4.3 [Grap controller]
In order to grap the packages the drone should have a grapper to pick up and deliver the package